test file "Gatera_Test"

suite "estados_test"

  case "GatoEntraExteriorAutomatico" [baseline]
    description: El sistema se sitúa en modo automático. Se testea la correcta entrada del gato desde el exterior, poniendo la ubicación a 1 cuando dicha entrada ha sido asegurada. AL ser el estado inicial del gato el interior del edificio, el test incluye la previa salida del gato, poniendo la ubicación a 0 (que no se comprueba explícitamente, pero si implícitamente porque sino el test nunca llegaría a comprobarse y se comprobaría en su estado).
    model estados_test, harness AAGatoEntraExteriorAuto
    assessment "Assessment1": At any point of time, if presOUT==1 becomes true then, with no delay, actGatera==1 must be true
    assessment "Assessment2": At any point of time, if ubicacion==1 becomes true then, with a delay of at most 5, actGatera==0 must be true
      presOUT: signal AAGatoEntraExteriorAuto/Input Conversion Subsystem, port 6
      actGatera: signal AAGatoEntraExteriorAuto/estados_test, port 1
      ubicacion: signal AAGatoEntraExteriorAuto/estados_test, port 6

  case "GatoEntraExteriorManual" [baseline]
    description: El sistema se sitúa en modo manual (debiendo fijar una hora de comida). Se testea la correcta entrada del gato desde el exterior, poniendo la ubicación a 1 cuando dicha entrada ha sido asegurada. Al ser el estado inicial del gato el interior del edificio, el test incluye la previa salida del gato, poniendo la ubicación a 0 (que no se comprueba explícitamente, pero si implícitamente porque sino el test nunca llegaría a comprobarse y se comprobaría en su estado).
    model estados_test, harness AABGatoEntraExteriorManual
    assessment "Assessment1": At any point of time, if presOUT==1 becomes true then, with no delay, actGatera==1 must be true
    assessment "Assessment2": At any point of time, if ubicacion==1 becomes true then, with a delay of at most 5, actGatera==0 must be true
      presOUT: signal AABGatoEntraExteriorManual/Input Conversion Subsystem, port 6
      actGatera: signal AABGatoEntraExteriorManual/estados_test, port 1
      ubicacion: signal AABGatoEntraExteriorManual/estados_test, port 6

  case "GatoNoEntraNormal" [baseline]
    description: Testea lo que ocurre cuando el gato se acerca a la gatera pero sin intención de salir, por lo que chipGatera no se llega a detectar. En este caso, al no aportar nada la variable ubicación, no es necesario establecer la salida del gato previa al testeo de la entrada. Se debe comprobar que la gatera finalmente se cierra.
    model estados_test, harness ABGatoNoEntraExterior
    assessment "Assessment1": At any point of time, if presOUT==1 becomes true then, with no delay, actGatera==1 must be true
    assessment "Assessment2": At any point of time, whenever presOUT==0 is true then, with no delay, actGatera==0 must be true
    assessment "Assessment3": At any point of time, whenever presOUT==1&actGatera==1 is true then, with a delay of at most 11, actGatera==0 must be true
      presOUT: signal ABGatoNoEntraExterior/Input Conversion Subsystem, port 6
      actGatera: signal ABGatoNoEntraExterior/estados_test, port 1

  case "GatoSaleNormalAutorizadoManual" [baseline]
    description: Testea la correcta salida del gato de la vivienda en modo manual, cuando el usuario autoriza su salida y el gato tiene intención de salir.
    model estados_test, harness ACGatoSaleNormalAutorizadoManual
    assessment "Assessment1": At any point of time, if autorizUsuario==1 becomes true then, with no delay, actGatera==1 must be true
    assessment "Assessment2": At any point of time, if presIN==1 becomes true then, with a delay of at most 5, peticionUsuario==1 must be true
    assessment "Assessment3": At any point of time, whenever tiempoSalida~=0 is true then, with a delay of at most 15, actGatera==0 must be true
      autorizUsuario: signal ACGatoSaleNormalAutorizadoManual/Input Conversion Subsystem, port 4
      actGatera: signal ACGatoSaleNormalAutorizadoManual/estados_test, port 1
      presIN: signal ACGatoSaleNormalAutorizadoManual/Input Conversion Subsystem, port 5
      peticionUsuario: signal ACGatoSaleNormalAutorizadoManual/estados_test, port 3
      tiempoSalida: signal ACGatoSaleNormalAutorizadoManual/estados_test, port 10

  case "CambioModoManualAutomatico" [baseline]
    description: Testea el correcto paso de modo manual a automático pidiendo al usuario que introduzca la hora a la que se alimentará a la mascota
    model estados_test, harness ADCambioModManAut
    assessment "Assessment1": At any point of time, if modo==0 becomes true then, with no delay, peticionIntHora==1 must be true
    assessment "Assessment2": At any point of time, whenever horaComida~=0&modo==0 is true then, with no delay, modoReal==0 must be true
      peticionIntHora: signal ADCambioModManAut/estados_test, port 4
      modo: signal ADCambioModManAut/Input Conversion Subsystem, port 1
      horaComida: signal ADCambioModManAut/Input Conversion Subsystem, port 8
      modoReal: signal ADCambioModManAut/estados_test, port 5

  case "CambioModoAutomaticoManual" [baseline]
    description: Testea que cuando el sistema esté en modo automático y se solicite el cambio a manual este se haga sin pedir nada al usuario.
    model estados_test, harness AECambioModoAutMan
    assessment "Assessment1": At any point of time, whenever modo == 1 is true then, with a delay of at most 5, modoReal == 1 must be true
      modo: signal AECambioModoAutMan/Input Conversion Subsystem, port 1
      modoReal: signal AECambioModoAutMan/estados_test, port 5

  case "AlimentarGatoM" [baseline]
    description: Suponiendo la selección del modo manual por parte del usuario, el presente test testea la correcta dispensa de comida en caso de que el usuario lo solicite, así como su parada una vez la comida ha sido dispensada.
    model estados_test, harness AFAlimentarGatoM
    assessment "Assessment1": At any point of time, whenever autorizUsuarioCom==1 is true then, with no delay, actComedero==1 & alertaDispensar==0 must be true
    assessment "Assessment3": At any point of time, whenever actComedero==1 is true then, with a delay of at most 11, actComedero==0 must be true
      actComedero: signal AFAlimentarGatoM/estados_test, port 2
      alertaDispensar: signal AFAlimentarGatoM/estados_test, port 14
      autorizUsuarioCom: signal AFAlimentarGatoM/Input Conversion Subsystem, port 3

  case "AlimentarGatoA" [baseline]
    description: Suponiendo la selección del modo automático por parte del usuario, el presente test testea la correcta dispensa de comida en las horas programadas para ello por el usuario.
      El funcionamiento del sistema está sincronizado con un reloj, de tal manera que cuando la hora coincide con la hora programada por el usuario para alimentar al gato, o se encuentra dentro de una región de confianza aceptable, dado que está seleccionado el modo automático, se realiza la secuencia de dispensa de comida.
      También se verifica su parada una vez la comida ha sido dispensada.
    model estados_test, harness AGAlimentarGatoA
    assessment "Assessment1": At any point of time, whenever t>=horaComida&t<(horaComida+10) is true then, with no delay, actComedero==1 must be true
    assessment "Assessment2": At any point of time, whenever actComedero==1 is true then, with a delay of at most 11, actComedero~=1 must be true
      actComedero: signal AGAlimentarGatoA/estados_test, port 2
      horaComida: signal AGAlimentarGatoA/Input Conversion Subsystem, port 8

  case "ParadaDeEmergencia" [baseline]
    description: Testea el paso a modo bloqueo en caso de producirse una parada de emergencia.
      También se testea la correcta parada de emergencia, de tal forma que en el momento en el que se pasa a modo bloqueo, la gatera no se accione.
      El test incluye la función de reestablecer el modo de tal forma que la gatera retorne al modo de uso en el que se encontraba antes de producirse la parada de emergencia, sea este el manual o el automático.
    model estados_test, harness AHParadaDeEmergencia
    assessment "Assessment1": At any point of time, whenever paradaEmergencia==1 is true then, with a delay of at most 1, modoReal==2 must be true
    assessment "Assessment2": At any point of time, whenever modoReal==2 is true then, with no delay, actGatera==0 must be true
    assessment "Assessment3": At any point of time, whenever reestablecerModo==1 & modoAnt==0 is true then, with no delay, modoReal==0 must be true
    assessment "Assessment4": At any point of time, whenever reestablecerModo==1 & modoAnt==1 is true then, with no delay, modoReal==1 must be true
      paradaEmergencia: signal AHParadaDeEmergencia/Input Conversion Subsystem, port 10
      modoReal: signal AHParadaDeEmergencia/estados_test, port 5
      actGatera: signal AHParadaDeEmergencia/estados_test, port 1
      reestablecerModo: signal AHParadaDeEmergencia/Input Conversion Subsystem, port 9
      modoAnt: signal AHParadaDeEmergencia/estados_test, port 17

  case "Ubicacion" [baseline]
    description: Testea que la información proporcionada al usuario acerca de la ubicación del animal, cuando este la solicita, es correcta.
      Dicha comprobación se ha realizado durante el proceso de entrada del gato al interior y su posterior salida, comprobando su ubicación en el exterior (0) cuando se detecta su presencia por primera vez en el exterior, y comprobando posteriormente su ubicación en el interior (1) tras haber entrado y solicitar su salida nuevamente.
    model estados_test, harness AIRegUbicacion
    assessment "Assessment1": At any point of time, whenever presOUT==1 is true then, with no delay, ubicacion==0 must be true
    assessment "Assessment2": At any point of time, if solUbicacion==1 becomes true then, with a delay of at most 5, peticionUbicacion==ubicacion must be true
    assessment "Assessment3": At any point of time, if presIN==1 becomes true then, with no delay, ubicacion==1 must be true
      solUbicacion: signal AIRegUbicacion/Input Conversion Subsystem, port 11
      ubicacion: signal AIRegUbicacion/estados_test, port 6
      peticionUbicacion: signal AIRegUbicacion/estados_test, port 18
      presIN: signal AIRegUbicacion/Input Conversion Subsystem, port 5
      presOUT: signal AIRegUbicacion/Input Conversion Subsystem, port 6

  case "NuevoGato" [baseline]
    description: Testea la correcta inclusión del nuevo gato en el sistema. Para ello, es necesario el reconocimiento del chip por parte de la gatera y del sensor.
    model estados_test, harness AJNuevoGato
    assessment "Assessment1": At any point of time, whenever nuevoGato==1 & gateraReconoce==1 & sensorReconoce==1 is true then, with no delay, gatoIntroducido==1 must be true
      nuevoGato: signal AJNuevoGato/Input Conversion Subsystem, port 14
      gateraReconoce: signal AJNuevoGato/Input Conversion Subsystem, port 12
      gatoIntroducido: signal AJNuevoGato/estados_test, port 7
      sensorReconoce: signal AJNuevoGato/Input Conversion Subsystem, port 13

  case "Observacion" [baseline]
    description: Testea el correcto funcionamiento de las cámaras alternativamente en función de la ubicación del animal, estando ambos test altamente relacionados entre sí.
      La comprobación se ha realizado durante el proceso de salida del gato al exterior, comprobando su ubicación en el interior en un inicio, mostrando imágenes del interior de la vivienda, y pasando a señalar que se encuentra en el exterior cuando el gato atraviesa la gatera, mostrando entonces imágenes de las cámaras del exterior.
    model estados_test, harness AKObservacion
    assessment "Assessment1": At any point of time, whenever solCamaras==1 & ubicacion==1 is true then, with a delay of at most 7, camarasIN==ubicacion must be true
    assessment "Assessment2": At any point of time, whenever solCamaras==1 & ubicacion==0 is true then, with no delay, camarasOUT==ubicacion must be true
      solCamaras: signal AKObservacion/Input Conversion Subsystem, port 15
      camarasIN: signal AKObservacion/estados_test, port 9
      camarasOUT: signal AKObservacion/estados_test, port 8
      ubicacion: signal AKObservacion/estados_test, port 6

  case "AlertaExcesoTiempoFueraAutomatico" [baseline]
    description: Verifica que el Gato está fuera más de un tiempo determinado alta la alerta de exceso de tiempo fuera. Válido para modo automático. El tiempo establecido es de 20 segundos y sólo en el caso de que sea superado se activará la alerta, debiendo desaparecer en caso contrario.
    model estados_test, harness ALAlertaExcesoTiempoFueraAuto
    assessment "Assessment1": At any point of time, whenever tiempoFuera>=20 is true then, with a delay of at most 5, alertaTiempoFuera==1 must be true
    assessment "Assessment2": At any point of time, whenever tiempoFuera<20 is true then, with no delay, alertaTiempoFuera==0 must be true
      tiempoFuera: signal ALAlertaExcesoTiempoFueraAuto/estados_test, port 12
      alertaTiempoFuera: signal ALAlertaExcesoTiempoFueraAuto/estados_test, port 11

  case "AlertaTiempoSinAlimentar" [baseline]
    description: Testea que se envíe correctamente una alerta cuando se ha superado un tiempo determinado desde la última vez que se dispensó comida. El tiempo establecido es de 25 segundos y sólo en ese caso deberá aparecer la alerta, debiendo desaparecer en caso contrario. Se deberá comprobar además que el sistema dispensa comida de forma automática si salta la alerta y el usuario está dormido, recibiendo dicha información de un sistema externo.
    model estados_test, harness ALAlertaTiempoSinAlimentar
    assessment "Assessment1": At any point of time, whenever tiempoSinAlimentar>=25 is true then, with a delay of at most 5, alertaDispensar==1 must be true
    assessment "Assessment2": At any point of time, if autorizUsuarioCom==1 becomes true then, with a delay of at most 30, alertaDispensar==0 & actComedero==1 must be true
    assessment "Assessment3": At any point of time, if propietarioDormido==1 becomes true then, with a delay of at most 30, alertaDispensar==0 & actComedero==1 must be true
    assessment "Assessment4": At any point of time, whenever alertaDispensar==0 & actComedero==1 is true then, with a delay of at most 17, actComedero==0 must be true
    assessment "Assessment5": At any point of time, whenever tiempoSinAlimentar<25 is true then, with a delay of at most 5, alertaDispensar==0 must be true
      tiempoSinAlimentar: signal ALAlertaTiempoSinAlimentar/estados_test, port 15
      alertaDispensar: signal ALAlertaTiempoSinAlimentar/estados_test, port 14
      autorizUsuarioCom: signal ALAlertaTiempoSinAlimentar/Input Conversion Subsystem, port 3
      propietarioDormido: signal ALAlertaTiempoSinAlimentar/Input Conversion Subsystem, port 16
      actComedero: signal ALAlertaTiempoSinAlimentar/estados_test, port 2

  case "AlertaLluvia" [baseline]
    description: Si llega al sistema un aviso de lluvia, deberá aparecer la alerta de lluvia en la aplicación. Si dicho aviso desaparece, de igual forma la alerta deberá desaparecer.
    model estados_test, harness AMAlertaLluvia
    assessment "Assessment1": At any point of time, whenever avisoLluvia==1 is true then, with no delay, alertaLluvia==1 must be true
    assessment "Assessment2": At any point of time, whenever avisoLluvia==0 is true then, with no delay, alertaLluvia==0 must be true
      avisoLluvia: signal AMAlertaLluvia/Input Conversion Subsystem, port 17
      alertaLluvia: signal AMAlertaLluvia/estados_test, port 16