% Requirement links of Gatera_Test.mldatx (R2020b)

item 1 verifies gatera.slreqx#19: RF-SY_06: Aviso de emergencia. El gato lleva demasiado tiempo en el exterior
item 2 verifies gatera.slreqx#2: RF-G_02: EL gato quiere entrar en la vivienda
item 3 verifies gatera.slreqx#1: RF-G_01: El gato quiere salir de la vivienda
item 4 verifies gatera.slreqx#2: RF-G_02: EL gato quiere entrar en la vivienda
item 5 verifies gatera.slreqx#20: RF-SY_08 (Requisito cruzado): Aviso de emergencia. Aviso de Lluvia
item 6 verifies gatera.slreqx#17: RF-SY_05: El dueño quiere introducir un nuevo gato en el sistema
item 7 verifies gatera.slreqx#15: RNF-SE_01: Parada de Emergencia
item 8 verifies gatera.slreqx#14: RF-CO_02: Alimentación del gato en modo automático
item 9 verifies gatera.slreqx#18: RF-CA_01: El dueño quiere ver las imágenes de las cámaras a tiempo real
item 10 verifies gatera.slreqx#21: RF-SY_07 (Requisito cruzado): Aviso de emergencia. El gato lleva demasiado tiempo sin alimentarse
item 11 verifies gatera.slreqx#16: RF-SY_04: El dueño quiere ver el registro de actividad del gato
item 12 verifies gatera.slreqx#7: RF-CO_01: Alimentación del gato en modo manual
item 13 verifies gatera.slreqx#4: RF-SY_02: Cambio de modo de automático a manual
item 14 verifies gatera.slreqx#2: RF-G_02: EL gato quiere entrar en la vivienda
item 15 verifies gatera.slreqx#3: RF-SY_01: Cambio de modo de uso de manual a automático